# Grasshopper definition GH_DRONEAPI_0728.gh (Grasshopper 0.9.76)
# plug-ins: horsterCameraControl, gHowl, Firefly, LunchBox

panel = Panel("SETUP 48.782074,9.172807,5;48.782028,9.172923,5;48.782096,9.173020,5;48.782142,9.172897,5 1,2,3,0")
landing_points = Panel("""48.782074,9.172807,0
48.782028,9.172923,0
48.782096,9.173020,5
48.782142,9.172897,5""")
alt = Data()
lat = Data()
lon = Data()
wpcoord = CSharpScript()  # -> out, messageLog, robotOutFlag, command; inputs wpCoord: list of String, wpSeq: list of Int32, start: Boolean, gotoNext: Boolean, status: String
# ---------- wpcoord: C# ----------
    if (start) {
      string wpCoordString = String.Join(";", wpCoord);
      string wpSeqString = String.Join(";", wpSeq);
      command = "SETUP " + wpCoordString + " " + wpSeqString;
      return;
    }

    if (gotoNext) {
      command = "GOTO_NEXT";
      return;
    }
# ---------- wpcoord: C# additional code ----------
  string CMD_ARMED = "ARMED {0}";
  string CMD_TAKEOFF = "TAKEOFF {0}";
  string CMD_GOTO = "GO_TO {0} {1} {2}";
  string CMD_LAND = "LAND";

  string[] commands = new string[] {};

  List<double> homePos = new List<double>();
  List<string> messageLog = new List<string>();
  int i_currLoc = 0; // Index of drone's current location
  int currLoc = 0; // Current location

  private List<double> parseUdpInput(List < string > udpInput) {
    List<double> parsedInput = new List<double>();
    foreach (string param in udpInput) {
      parsedInput.Add(Convert.ToDouble(param));
    }
    return parsedInput;
  }

  private List<double> parseWpCoord(string wpCoord) {
    char[] delimiters = {','};
    string[] elements = wpCoord.Split(delimiters);
    List<string> listOfElements = new List<string>(elements);
    List<double> coords = listOfElements.Select(double.Parse).ToList();

    return coords;
  }
# ---------- end wpcoord ----------
setup = Button()
goto_next = Button()
show_trail = BooleanToggle(True)
camera_view = BooleanToggle(True)

wp_seq = Panel("""1
2
3
0""")
waypoints_lat_lon_alt = Panel("""48.7452524,9.0968647,5
48.7454152,9.0970686,5
48.7453321,9.0973100,5
48.7451817,9.0970954,5""")
panel_2 = Panel("""lat=
lon=
alt=
is_relative=
pitch=
yaw=
roll=
mode=""")

# ---- group: produce setup command
cluster = Cluster_6(wp_sequence=wp_seq, waypoints_lat_lon_alt=waypoints_lat_lon_alt)

# ---- group: display waypoints
cluster_2 = Cluster_2(coordinate_list=waypoints_lat_lon_alt)  # -> distance_to_origin_2, llocation_2
points = PointList(Points=expr("x+ {0.5,0.5,0}", cluster_2.llocation_2), Size=1)
xy = XYPlane(Origin=cluster_2.llocation_2)
order = PointOrder(Points=cluster_2.llocation_2)

# ---- group: trigger commands
cluster_3 = Cluster_5(command_1=cluster, button_1=setup, button_2=goto_next)

# ---- group: send / receive / parse
panel_3 = Panel(cluster_3)
timer = Timer(TimerInterval=20, Target=[udp_2, cluster_3])
udp = UDPReceiver(Port="8001", Pattern=0)  # -> Info, Data
udp_2 = UDPSender(Port="8000", Pattern=0, Data=panel_3)
cluster_4 = Cluster_4(data=udp.Data)  # -> data_5, lat_2, lon_2, alt_2, pitch_2, yaw_2, roll_2, mode_2

# ----
cluster_5 = Cluster_3(
    coordinate_list=waypoints_lat_lon_alt,
    current_latitude=cluster_4.lat_2,
    current_longitude=cluster_4.lon_2,
    current_altitude=cluster_4.alt_2)  # -> distance_to_origin_2, llocation_2

produced_command = Panel(cluster)
distance_to_origin_m = Panel(cluster_4.mode_2)
distance_to_origin_m_2 = Panel(cluster_5.distance_to_origin_2)
panel_4 = Panel(cluster_4.data_5)

# ---- group: POINT TRAIL
location = Data(cluster_5.llocation_2)
blink = BinaryBlink(BlinkPattern=200, Start=show_trail, Repeat=True)
pt = Point(location)
bake = ObjectBake(
    BakeToggle=blink,
    GeometryObjects=pt,
    Layer="GH_Bake",
    ObjectName="GH_Obj",
    ObjectColor=RGB(255, 255, 255),
    LayerColor=RGB(255, 255, 255))
panel_5 = Panel(blink)

# ----
xy_2 = XYPlane(Origin=Point(0, 0, 0))
roll = Data(cluster_4.roll_2)
pitch = Data(cluster_4.pitch_2)
yaw = Data(cluster_4.yaw_2)
location_2 = Data(cluster_5.llocation_2)
box = CenterBox(Base=xy_2, X=0.4, Y=0.4, Z=0.1)
deplane = DeconstructPlane(Plane=xy_2)  # -> Origin, XAxis, YAxis, ZAxis
xy_3 = XYPlane(Origin=location_2)

# ---- group: yaw
rot3d = Rotate3D(Geometry=xy_2, Angle=expr("x*-1", yaw), Center=Point(0, 0, 0), Axis=deplane.ZAxis)  # -> Geometry, Transform

# ----
deplane_2 = DeconstructPlane(Plane=rot3d.Geometry)  # -> Origin, XAxis, YAxis, ZAxis

# ---- group: roll
rot3d_2 = Rotate3D(Geometry=rot3d.Geometry, Angle=roll, Center=Point(0, 0, 0), Axis=deplane_2.YAxis)  # -> Geometry, Transform

# ----
deplane_3 = DeconstructPlane(Plane=rot3d_2.Geometry)  # -> Origin, XAxis, YAxis, ZAxis

# ---- group: pitch
rot3d_3 = Rotate3D(Geometry=rot3d_2.Geometry, Angle=pitch, Center=Point(0, 0, 0), Axis=deplane_3.XAxis)  # -> Geometry, Transform

# ----
pl_origin = PlaneOrigin(Base=rot3d_3.Geometry, Origin=xy_3)
orient = Orient(Geometry=box, Source=xy_2, Target=pl_origin)  # -> Geometry, Transform

# ---- group: camera control
deplane_4 = DeconstructPlane(Plane=pl_origin)  # -> Origin, XAxis, YAxis, ZAxis
pl_origin_2 = PlaneOrigin(Base=rot3d.Geometry, Origin=deplane_4.Origin)
vdis = VectorDisplay(Anchor=deplane_4.Origin, Vector=deplane_4.YAxis)
deplane_5 = DeconstructPlane(Plane=pl_origin_2)  # -> Origin, XAxis, YAxis, ZAxis
eval = Evaluate(F="V*amp*scale", V=deplane_5.YAxis, amp=Slider(-1, range=-1..1), scale=Slider(5, range=1..10))
eval_2 = Evaluate(F="V*amp*scale", V=deplane_5.ZAxis, amp=Slider(1, range=-1..1), scale=Slider(2, range=1..10))
ma = MassAddition(Input=[eval, eval_2, deplane_5.XAxis])  # -> Result, PartialResults
move = Move(Geometry=deplane_4.Origin, Motion=ma.Result)  # -> Geometry, Transform

# ---- group: camera control / smooth location
cluster_6 = Cluster(P=move.Geometry)

cluster_7 = Cluster(P=deplane_4.Origin)

# ---- group: camera control (continued)
setcam = SetCamera(CameraLocation=cluster_6, TargetLocation=cluster_7, LensLength=20, UpDirection=deplane_4.ZAxis, Activate=camera_view)

# ==== cluster Cluster
P = ClusterInput()
pt2num = PointsToNumbers(Points=P, Mask=4)
item = ListItem(List=pt2num, Index=0, Wrap=True)  # -> Item, Item1, Item2
smoothing = SmoothingTemporal(Number=item.Item, SmoothingFactor=0.9)
smoothing_2 = SmoothingTemporal(Number=item.Item1, SmoothingFactor=0.9)
smoothing_3 = SmoothingTemporal(Number=item.Item2, SmoothingFactor=0.9)
pt2num_2 = NumbersToPoints(Numbers=[smoothing, smoothing_2, smoothing_3], Mask=4)
P_2 = ClusterOutput(pt2num_2)

# ==== cluster Cluster_2
coordinate_list = ClusterInput()
coordinate_list_2 = Data(coordinate_list)
split = TextSplit(Text=coordinate_list_2, Separators=",")
item = ListItem(List=split, Index=0, Wrap=True)  # -> Item, Item1, Item2
longitude_1deg = Panel("111415.13*cos(rad(Phi))+94.55*cos(rad(3*Phi))+0.12*Cos(rad(5*Phi))")
latitude_1deg = Panel("111132.09-566.05*cos(rad(2*Phi))+1.20*cos(rad(4*Phi))")
latitude = Data(flatten(item.Item))
longitude = Data(flatten(item.Item1))
altitude = Data(flatten(item.Item2))
item_2 = ListItem(List=longitude, Index=0, Wrap=True)
item_3 = ListItem(List=latitude, Index=0, Wrap=True)
panel = Panel(item_3)
eval = Evaluate(F=latitude_1deg, Phi=panel)
eval_2 = Evaluate(F=longitude_1deg, Phi=panel)
longitude_1deg_in_meters = Panel(eval_2)
lat_1deg_in_meters = Panel(eval)
python = PythonScript(x=lat_1deg_in_meters, y=latitude)  # -> out, a
# ---------- python: Python ----------
a= float(x)*float(y)
print a
# ---------- end python ----------
python_2 = PythonScript(x=longitude_1deg_in_meters, y=longitude)  # -> out, a; same code as python

# ---- group: offset to 0,0 at home loc
lat = Panel(item_3)
lon = Panel(item_2)
latitudes = Panel(python.out)
longitudes = Panel(python_2.out)
python_3 = PythonScript(x=longitude_1deg_in_meters, y=lon)  # -> out, a; same code as python
python_4 = PythonScript(x=lat_1deg_in_meters, y=lat)  # -> out, a; same code as python
subtraction = Subtraction(A=graft(latitudes), B=python_4.out)  # -> flatten(Result)
subtraction_2 = Subtraction(A=graft(longitudes), B=python_3.out)  # -> flatten(Result)
lat_2 = Panel(subtraction_2)

# ----
pt = ConstructPoint(XCoordinate=subtraction_2, YCoordinate=subtraction, ZCoordinate=altitude)
pt_2 = Point(pt)
panel_2 = Panel(coordinate_list_2)
panel_3 = Panel(pt)
tag = TextTag(Location=pt, Text=coordinate_list_2)
points = PointList(Points=pt, Size=3)
dist = Distance(PointA=Point(0, 0, 0), PointB=pt)
distance_to_origin = Data(dist)
llocation = Data(pt)
distance_to_origin_2 = ClusterOutput(distance_to_origin)
llocation_2 = ClusterOutput(llocation)

# ==== cluster Cluster_3
coordinate_list = ClusterInput()
coordinate_list_2 = Data(coordinate_list)
split = TextSplit(Text=coordinate_list_2, Separators=",")
item = ListItem(List=split, Index=0, Wrap=True)  # -> Item, Item1, Item2
longitude_1deg = Panel("111415.13*cos(rad(Phi))+94.55*cos(rad(3*Phi))+0.12*Cos(rad(5*Phi))")
latitude_1deg = Panel("111132.09-566.05*cos(rad(2*Phi))+1.20*cos(rad(4*Phi))")
longitude = Data(flatten(item.Item1))
altitude = Data(flatten(item.Item2))
latitude = Data(flatten(item.Item))
item_2 = ListItem(List=longitude, Index=0, Wrap=True)
item_3 = ListItem(List=latitude, Index=0, Wrap=True)
panel = Panel(item_3)
current_longitude = ClusterInput()
current_altitude = ClusterInput()
current_latitude = ClusterInput()
eval = Evaluate(F=latitude_1deg, Phi=panel)
eval_2 = Evaluate(F=longitude_1deg, Phi=panel)
current_altitude_2 = Data(current_altitude)
current_latitude_2 = Data(current_latitude)
current_longitude_2 = Data(current_longitude)
longitude_1deg_in_meters = Panel(eval_2)
lat_1deg_in_meters = Panel(eval)
python = PythonScript(x=longitude_1deg_in_meters, y=item_2)  # -> out, a; same code as python
python_2 = PythonScript(x=lat_1deg_in_meters, y=item_3)  # -> out, a; same code as python
python_3 = PythonScript(x=lat_1deg_in_meters, y=current_latitude_2)  # -> out, a; same code as python
python_4 = PythonScript(x=longitude_1deg_in_meters, y=current_longitude_2)  # -> out, a; same code as python

# ---- group: offset to 0,0 at home loc
home_latitude = Panel(python_2.out)
home_longitude = Panel(python.out)
subtraction = Subtraction(A=python_4.out, B=home_longitude)
subtraction_2 = Subtraction(A=python_3.out, B=home_latitude)
panel_2 = Panel(subtraction_2)

# ----
panel_3 = Panel(subtraction)
pt = ConstructPoint(XCoordinate=subtraction, YCoordinate=subtraction_2, ZCoordinate=current_altitude_2)
dist = Distance(PointA=Point(0, 0, 0), PointB=pt)  # -> expr("round(x,1)", Distance)
panel_4 = Panel(pt)
cluster = Cluster(P=pt)
distance_to_origin = Data(dist)
llocation = Data(cluster)
distance_to_origin_2 = ClusterOutput(distance_to_origin)
llocation_2 = ClusterOutput(llocation)

# ==== cluster Cluster_4
data = ClusterInput()
data_2 = Data(data)
panel = Panel("""Location:
Attitude:""")
split = TextSplit(Text=data_2, Separators=" ;")
rep = ReplaceText(Text=split, Find=panel, RecursiveReplace=False)
panel_2 = Panel("""lat=
lon=
alt=
is_relative=
pitch=
yaw=
roll=""")
split_2 = TextSplit(Text=rep, Separators=",")  # -> flatten(Result)
rep_2 = ReplaceText(Text=split_2, Find=panel_2, RecursiveReplace=False)
data_3 = Data(rep_2)
item = ListItem(List=data_3, Index=6, Wrap=True)
item_2 = ListItem(List=data_3, Index=4, Wrap=True)
item_3 = ListItem(List=data_3, Index=5, Wrap=True)
item_4 = ListItem(List=data_3, Index=7, Wrap=True)
item_5 = ListItem(List=data_3, Index=0, Wrap=True)
item_6 = ListItem(List=data_3, Index=2, Wrap=True)
data_4 = Data(data_3)
item_7 = ListItem(List=data_3, Index=1, Wrap=True)
alt = Data(item_6)
lat = Data(item_5)
lon = Data(item_7)
pitch = Data(item_2)
roll = Data(item)
yaw = Data(item_3)
mode = Data(item_4)
roll_2 = ClusterOutput(roll)
yaw_2 = ClusterOutput(yaw)
mode_2 = ClusterOutput(mode)
lat_2 = ClusterOutput(lat)
alt_2 = ClusterOutput(alt)
lon_2 = ClusterOutput(lon)
pitch_2 = ClusterOutput(pitch)
data_5 = ClusterOutput(data_4)

# ==== cluster Cluster_5
button_1 = ClusterInput()
command_1 = ClusterInput()
button_2 = ClusterInput()
button_3 = ClusterInput()
command_3 = ClusterInput()
button_1_2 = Data(button_1)
command_1_2 = Data(command_1)
button_2_2 = Data(button_2)
command_2 = Data("GOTO_NEXT")
button_3_2 = Data(button_3)
command_3_2 = Data(command_3)
bang = Bang(BooleanInput=button_1_2)  # -> TrueState, FalseState
bang_2 = Bang(BooleanInput=button_2_2)  # -> TrueState, FalseState
bang_3 = Bang(BooleanInput=button_3_2)  # -> TrueState, FalseState
gate = StreamGate(Stream=command_1_2, Gate=bang.TrueState)  # -> Target0, Target1
gate_2 = StreamGate(Stream=command_2, Gate=bang_2.TrueState)  # -> Target0, Target1
gate_3 = StreamGate(Stream=command_3_2, Gate=bang_3.TrueState)  # -> Target0, Target1
out = Data([gate.Target1, gate_2.Target1, gate_3.Target1])
out_2 = ClusterOutput(out)

# ==== cluster Cluster_6
wp_sequence = ClusterInput()
waypoints_lat_lon_alt = ClusterInput()
wp_sequence_2 = Data(wp_sequence)
waypoints_lat_lon_alt_2 = Data(waypoints_lat_lon_alt)
join = TextJoin(Text=waypoints_lat_lon_alt_2, Join=";")
join_2 = TextJoin(Text=wp_sequence_2, Join=",")
join_3 = TextJoin(Text=["SETUP", join, join_2], Join=" ")
setup_command = Data(join_3)
setup_command_2 = ClusterOutput(setup_command)
