# Grasshopper definition receive.gh (Grasshopper 0.9.76)

wpcoord = CSharpScript()  # -> out, messageLog, robotOutFlag, command; inputs wpCoord: list of String, wpSeq: list of Int32, start: Boolean, gotoNext: Boolean, status: String
# ---------- wpcoord: C# ----------
    if (start) {
      string wpCoordString = String.Join(";", wpCoord);
      string wpSeqString = String.Join(";", wpSeq);
      command = "SETUP " + wpCoordString + " " + wpSeqString;
      return;
    }

    if (gotoNext) {
      command = "GOTO_NEXT";
      return;
    }
# ---------- wpcoord: C# additional code ----------
  string CMD_ARMED = "ARMED {0}";
  string CMD_TAKEOFF = "TAKEOFF {0}";
  string CMD_GOTO = "GO_TO {0} {1} {2}";
  string CMD_LAND = "LAND";

  string[] commands = new string[] {};

  List<double> homePos = new List<double>();
  List<string> messageLog = new List<string>();
  int i_currLoc = 0; // Index of drone's current location
  int currLoc = 0; // Current location

  private List<double> parseUdpInput(List < string > udpInput) {
    List<double> parsedInput = new List<double>();
    foreach (string param in udpInput) {
      parsedInput.Add(Convert.ToDouble(param));
    }
    return parsedInput;
  }

  private List<double> parseWpCoord(string wpCoord) {
    char[] delimiters = {','};
    string[] elements = wpCoord.Split(delimiters);
    List<string> listOfElements = new List<string>(elements);
    List<double> coords = listOfElements.Select(double.Parse).ToList();

    return coords;
  }
# ---------- end wpcoord ----------
