# Grasshopper definition udp_receiver [Jul-07 '15, 1607].gh (Grasshopper 0.9.76)
# plug-ins: horsterCameraControl, gHowl, Firefly, LunchBox, Firefly_X

update_time_ms = Slider(100, range=10..1000)
button = Button()
panel = Panel(button)
bang = Bang(BooleanInput=button)  # -> TrueState, FalseState
blink = BinaryBlink(BlinkPattern=update_time_ms, Start=Toggle(True), Repeat=True)
c_script = CSharpScript(x=bang.TrueState)  # -> out, A; inputs x: Boolean
# ---------- c_script: C# ----------
    if (x) {
      A = "ARMED true";
    }
# ---------- end c_script ----------
panel_2 = Panel(c_script.A)
timer = Timer(TimerInterval=50, Target=[udp_2, bang])  # disabled
udp = UDPReceiver(Port="8001", Pattern=0)  # -> Info, Data
udp_2 = UDPSender(Port="8000", Pattern=0, Data=panel_2)
panel_3 = Panel("""Location:
Attitude:""")
split = TextSplit(Text=udp.Data, Separators=" ;")
rep = ReplaceText(Text=split, Find=panel_3, RecursiveReplace=False)
split_2 = TextSplit(Text=rep, Separators=",")  # -> flatten(Result)

# ---- group: LAT, LON to XYZ, meters
longitude_1deg = Panel("111415.13*cos(rad(Phi))+94.55*cos(rad(3*Phi))+0.12*Cos(rad(5*Phi))")
latitude_1deg = Panel("111132.09-566.05*cos(rad(2*Phi))+1.20*cos(rad(4*Phi))")
eval = Evaluate(F=longitude_1deg, Phi="-35.36")
eval_2 = Evaluate(F=latitude_1deg, Phi="-35.36")
longitude_1deg_in_meters = Panel(eval)
lat_1deg_in_meters = Panel(eval_2)

# ----
panel_4 = Panel("""lat=
lon=
alt=
is_relative=
pitch=
yaw=
roll=""")

rep_2 = ReplaceText(Text=split_2, Find=panel_4, RecursiveReplace=False)

panel_5 = Panel(rep_2)

item = ListItem(List=panel_5, Index=0, Wrap=True)  # -> Item, Item1, Item2, Item3, Item4, Item5, Item6

# ---- group: LAT, LON to XYZ, meters (continued)
multiplication = Multiplication(A=lat_1deg_in_meters, B=item.Item)
multiplication_2 = Multiplication(A=longitude_1deg_in_meters, B=item.Item1)
pt = ConstructPoint(XCoordinate=multiplication_2, YCoordinate=multiplication, ZCoordinate=item.Item2)

# ---- group: offset
vec = Vector(Vector(-13549596.79, 3923343.485, -543.8499756))
move = Move(Geometry=pt, Motion=vec)  # -> Geometry, Transform

# ---- group: distance to origin
dist = Distance(PointA=Point(0, 0, 0), PointB=move.Geometry)
panel_6 = Panel(dist)

# ---- group: smooth location
cluster = Cluster(P=move.Geometry)

# ---- group: display rotation
xy = XYPlane(Origin=Point(0, 0, 0))
deplane = DeconstructPlane(Plane=xy)  # -> Origin, XAxis, YAxis, ZAxis
box = CenterBox(Base=xy, X=0.4, Y=0.4, Z=0.1)

# ---- group: display rotation / yaw
rot3d = Rotate3D(Geometry=xy, Angle=expr("x*-1", item.Item5), Center=Point(0, 0, 0), Axis=deplane.ZAxis)  # -> Geometry, Transform

# ---- group: display rotation (continued)
deplane_2 = DeconstructPlane(Plane=rot3d.Geometry)  # -> Origin, XAxis, YAxis, ZAxis

# ---- group: display rotation / roll
rot3d_2 = Rotate3D(Geometry=rot3d.Geometry, Angle=item.Item6, Center=Point(0, 0, 0), Axis=deplane_2.YAxis)  # -> Geometry, Transform

# ---- group: display rotation (continued)
deplane_3 = DeconstructPlane(Plane=rot3d_2.Geometry)  # -> Origin, XAxis, YAxis, ZAxis

# ---- group: display rotation / pitch
rot3d_3 = Rotate3D(Geometry=rot3d_2.Geometry, Angle=item.Item4, Center=Point(0, 0, 0), Axis=deplane_3.XAxis)  # -> Geometry, Transform

# ---- group: display rotation (continued)
pl_origin = PlaneOrigin(Base=rot3d_3.Geometry, Origin=cluster)
orient = Orient(Geometry=box, Source=xy, Target=pl_origin)  # -> Geometry, Transform

# ---- group: POINT TRAIL
blink_2 = BinaryBlink(BlinkPattern=100, Start=Toggle(False), Repeat=True)
pt_2 = Point(pl_origin)
bake = ObjectBake(
    BakeToggle=blink_2,
    GeometryObjects=pt_2,
    Layer="GH_Bake",
    ObjectName="GH_Obj",
    ObjectColor=RGB(255, 255, 255),
    LayerColor=RGB(255, 255, 255))
panel_7 = Panel(blink_2)

# ---- group: camera
deplane_4 = DeconstructPlane(Plane=pl_origin)  # -> Origin, XAxis, YAxis, ZAxis
pl_origin_2 = PlaneOrigin(Base=rot3d.Geometry, Origin=deplane_4.Origin)
vdis = VectorDisplay(Anchor=deplane_4.Origin, Vector=deplane_4.YAxis)
deplane_5 = DeconstructPlane(Plane=pl_origin_2)  # -> Origin, XAxis, YAxis, ZAxis
eval_3 = Evaluate(F="V*amp*scale", V=deplane_5.ZAxis, amp=Slider(1, range=-1..1), scale=Slider(2, range=1..10))
eval_4 = Evaluate(F="V*amp*scale", V=deplane_5.YAxis, amp=Slider(-1, range=-1..1), scale=Slider(10, range=1..10))
ma = MassAddition(Input=[eval_4, eval_3, deplane_5.XAxis])  # -> Result, PartialResults
move_2 = Move(Geometry=deplane_4.Origin, Motion=ma.Result)  # -> Geometry, Transform
camera_view = BooleanToggle(True)
num = Number(30)

# ---- group: camera / smooth location
cluster_2 = Cluster(P=move_2.Geometry)

cluster_3 = Cluster(P=deplane_4.Origin)

# ---- group: camera (continued)
setcam = SetCamera(CameraLocation=cluster_2, TargetLocation=cluster_3, LensLength=num, UpDirection=deplane_4.ZAxis, Activate=camera_view)

# ==== cluster Cluster
P = ClusterInput()
pt2num = PointsToNumbers(Points=P, Mask=4)
item = ListItem(List=pt2num, Index=0, Wrap=True)  # -> Item, Item1, Item2
smoothing = SmoothingTemporal(Number=item.Item, SmoothingFactor=0.9)
smoothing_2 = SmoothingTemporal(Number=item.Item1, SmoothingFactor=0.9)
smoothing_3 = SmoothingTemporal(Number=item.Item2, SmoothingFactor=0.9)
pt2num_2 = NumbersToPoints(Numbers=[smoothing, smoothing_2, smoothing_3], Mask=4)
P_2 = ClusterOutput(pt2num_2)
